# Grasshopper definition Test_Fr.gh (Grasshopper 0.9.76)
# Copyright: Ángel Linares García 2014
# plug-ins: GH2SAP

# Abre un archivo vacío de SAP y dale al toggle
set_me_true = BooleanToggle(True)

panel = Panel("""10
4""")  # disabled
pt = ConstructPoint(XCoordinate=panel, YCoordinate=graft(panel), ZCoordinate=0)  # -> flatten(Point); disabled
pt_2 = ConstructPoint(XCoordinate=0, YCoordinate=0, ZCoordinate=0)  # disabled
ln = Line(StartPoint=pt_2, EndPoint=pt)  # disabled

io = IO(IO=set_me_true, Mode=0, Link=True, Path="F:\GH2SAP\DocumentName.sdb")  # -> Message, Flag
crv = Curve([<curve referenced from the Rhino model> x81])
line = Line(crv)
frimp = FrImport(Frame=line, FrameSection="Sec_1", Name="FrameElemt", Start=io.Flag)
